# Dynamo graph HelloUser.dyn (Dynamo 2.0.2.6826)

code_block = CodeBlock { "Hello, "; }
python_script = Python()
# ---------- python_script.python (3 lines) ----------
import clr
from System import Environment
OUT = Environment.UserName
# ----------------------------------------
add = code_block + python_script
watch = Watch(add)
